# Grasshopper definition offset.gh (Grasshopper 1.0.7)
# plug-ins: GrassPlugin, ClipperComponents

number_slider = Slider(100, range=0..100)
crv = Curve(<curve referenced from the Rhino model>)
subtraction = Subtraction(B=5)
offset = OffsetCurve(Curve=crv, Distance=number_slider, Corners=1)
nickname = GrassPlugin(Curve=crv, Offset=number_slider)
polyoffset = PolylineOffset(
    Polylines=crv,
    Distance=number_slider,
    Plane=Plane(origin=(0, 0, 0), x=(0, 0, 0), y=(0, 0, 0)),
    Tolerance=Slider(1, range=0..1),
    ClosedFillet=2,
    OpenFillet=1,
    Miter=Slider(5, range=0..10))  # -> Contour, Holes
cp = ControlPoints(Curve=nickname)  # -> Points, Weights, Knots
panel = Panel(polyoffset.Holes)
panel_2 = Panel(polyoffset.Contour)
